# Grasshopper definition AdSecGH_Example1_RectangularBeam.gh (Grasshopper 1.0.7)
# Copyright: Arup
# plug-ins: AdSec, UnitNumber

material = StandardMaterial(Material_Type="Rebar", Design_Code="EN1992", National_Annex="GB", Edition="Edition_2014", Grade="S500B")

# ---- group: Main profile
xy = XYPlane(Origin=Point(0, 0, 0))
profile = CreateProfile(
    Depth_mm=Slider(600, range=0..1000),
    Width_mm=Slider(300, range=0..1000),
    LocalPlane=xy,
    catalogueIndex=-1,
    inclSS=False,
    lengthUnit="Millimeter",
    mode="Other",
    Profile_type="Rectangle",
    Measure="Millimeter",
    typeIndex=-1)

# ---- group: Sides
rebar = CreateRebar(Material=material, Diameter_mm=Slider(16, range=0..100), Rebar_Type="Single", Measure="Millimeter")
spacing = CreateRebarSpacing(Rebar=rebar, Spacing_mm=Slider(200, range=0..1000), Spacing_method="Distance", Measure="Millimeter")

# ---- group: Bottom
rebar_2 = CreateRebar(Material=material, Diameter_mm=Slider(25, range=0..100), Rebar_Type="Single", Measure="Millimeter")
spacing_2 = CreateRebarSpacing(Rebar=rebar_2, Count=Slider(4, range=0..10), Spacing_method="Count")

# ----
material_2 = StandardMaterial(Material_Type="Concrete", Design_Code="EN1992", National_Annex="GB", Edition="Edition_2014", Grade="C30_37")

# ---- group: Top
rebar_3 = CreateRebar(Material=material, Diameter_mm=Slider(16, range=0..100), Rebar_Type="Single", Measure="Millimeter")
spacing_3 = CreateRebarSpacing(Rebar=rebar_3, Count=Slider(4, range=0..10), Spacing_method="Count")

# ----
number_slider = Slider(30, range=0..100)

# ---- group: Links
rebar_4 = CreateRebar(Material=material, Diameter_mm=Slider(10, range=0..100), Rebar_Type="Single", Measure="Millimeter")
reinforcement_group = CreateReinforcementGroup(Rebar=rebar_4, Cover_mm=number_slider, Group_Type="Link", Measure="Millimeter")

# ----
reinforcement_group_2 = CreateReinforcementGroup(
    TopRebars=spacing_3,
    LeftSideRebars=spacing,
    RightSideRebars=spacing,
    BottomRebars=spacing_2,
    Cover_mm=number_slider,
    Group_Type="Template",
    Measure="Millimeter")
rbg = RebarGroup(flatten([reinforcement_group_2, reinforcement_group]))

# ---- group: Create Section
section = Section(Profile=profile, Material=material_2, RebarGroup=rbg)

# ----
section_2 = Section(Section=section)  # -> Section, Profile, Material, DesignCode, RebarGroup, SubComponent, SectionCurves

# ---- group: Analyse solution
analyse = AnalyseSection(Section=section)  # -> Results, FailureSurface

# ----
profileedit = EditProfile(Profile=section_2.Profile, Measure="Radian")
neg = Negative(Value=Slider(200, range=0..10000))

# ---- group: Bake these guys
crv = Curve(section_2.SectionCurves)

# ---- group: Top right corner point
vertex_point = CreateVertexPoint(Y_mm=Slider(150, range=0..1000), Z_mm=Slider(-300, range=-500..0), Measure="Millimeter")

# ----
load = CreateLoad(
    Myy_kN_m=Slider(64, range=0..100),
    Mzz_kN_m=Slider(10, range=0..100),
    Force_Unit="Kilonewton",
    Moment_Unit="KilonewtonMeter")
load_2 = CreateLoad(
    Fx_kN=neg,
    Myy_kN_m=Slider(55, range=0..100),
    Mzz_kN_m=Slider(11, range=0..100),
    Force_Unit="Kilonewton",
    Moment_Unit="KilonewtonMeter")
lng = ListLength(List=crv)

# ---- group: CadTest
int = Integer(lng)

# ----
uls = StrengthResult(Results=analyse.Results, Load=load_2)  # -> Load, LoadUtil, Deformation, DeformationUtil, MomentRanges, NeutralAxis, NeutralAxisOffset, NeutralAxisAngle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
sls = ServiceabilityResult(Results=analyse.Results, Load=load)  # -> Load, Cracks, MaximumCrack, CrackUtil, Deformation, SecantStiffness, UncrackedMomentRanges

# ---- group: Rebar stress for all bars
rss = RebarStressStrain(Results=analyse.Results, Load=load_2)  # -> Position_mm, ULSStrain, ULSStress, SLSStrain, SLSStress

# ---- group: Concrete stress at YZ point
css = ConcreteStressStrain(Results=analyse.Results, Load=load_2, VertexPoint=vertex_point)  # -> ULSStrain_, ULSStress_MPa, SLSStrain_, SLSStress_MPa

# ----
panel = Panel(sls.Cracks)
panel_2 = Panel(uls.LoadUtil)

# ---- group: Neutral line
line = Line(uls.NeutralAxis)

# ----
panel_3 = Panel(sls.CrackUtil)
panel_4 = Panel(rss.Position_mm)
pt = ConstructPoint(XCoordinate="500", YCoordinate=0, ZCoordinate=0)
rad = Radians(Degrees=Slider(-170, range=-190..90))
rectangle = Rectangle(Plane=pt, XSize=Slider(500, range=0..1000), YSize=Slider(605, range=0..1000), Radius=0)  # -> Rectangle, Length

# ---- group: LoadUtilisationTest
num = Number(uls.LoadUtil)

# ---- group: CrackUtilisationTest
num_2 = Number(sls.CrackUtil)

# ----
convertunit = ConvertUnitNumber(UnitNumber=css.SLSStrain_, Select_output_unit="‰")
convertunit_2 = ConvertUnitNumber(UnitNumber=css.ULSStrain_, Select_output_unit="‰")
n_m_diagram = NMDiagram(Results=analyse.Results, MomentAngle_rad=rad, Plot=rectangle.Rectangle, Interaction="N-M", Measure="Radian")
convertunit_3 = ConvertUnitNumber(UnitNumber=rss.ULSStrain, Select_output_unit="‰")
convertunit_4 = ConvertUnitNumber(UnitNumber=rss.SLSStrain, Select_output_unit="‰")
panel_5 = Panel([convertunit_2, css.ULSStress_MPa, convertunit, css.SLSStress_MPa])

# ---- group: RebarUlsStressTest
num_3 = Number(rss.ULSStress)

# ---- group: RebarSlsStressTest
num_4 = Number(rss.SLSStress)

# ----
crv_2 = Curve(n_m_diagram)

# ---- group: RebarUlsStrainTest
num_5 = Number(convertunit_3)

# ---- group: RebarSlsStrainTest
num_6 = Number(convertunit_4)

# ----
boundary = BoundarySurfaces(Edges=crv_2)
panel_6 = Panel(convertunit_3)
area = Area(Geometry=boundary)  # -> Area, Centroid

# ---- group: ConcreteStressTest
num_7 = Number([convertunit_2, css.ULSStress_MPa, convertunit, css.SLSStress_MPa])

# ---- group: NmDiagramTest
num_8 = Number(area.Area)
