# Grasshopper definition AdSecGH_Example2_CompositeColumn.gh (Grasshopper 1.0.7)
# Copyright: Arup
# plug-ins: AdSec

material = StandardMaterial(Material_Type="Rebar", Design_Code="EN1992", National_Annex="GB", Edition="Edition_2014", Grade="S500B")

# ---- group: Main profile
xy = XYPlane(Origin=Point(0, 0, 0))
profile = CreateProfile(
    Diameter_mm=Slider(500, range=0..1000),
    LocalPlane=xy,
    NumberOfInputs=1,
    catalogueIndex=-1,
    inclSS=False,
    lengthUnit="Millimeter",
    mode="Other",
    Profile_type="Circle",
    Measure="Millimeter",
    typeIndex=-1)

# ---- group: Longitudinal bars
rebar = CreateRebar(Material=material, Diameter_mm=Slider(20, range=0..100), mode="Single", Rebar_Type="Single", Measure="Millimeter")
spacing = CreateRebarSpacing(Rebar=rebar, Spacing_m=Slider(150, range=0..1000), mode="Distance", Spacing_method="Distance", Measure="Millimeter")

# ----
material_2 = StandardMaterial(Material_Type="Concrete", Design_Code="EN1992", National_Annex="GB", Edition="Edition_2014", Grade="C40_50")

# ---- group: Sub component for composite section
xy_2 = XYPlane(Origin=Point(0, 0, 0))
profile_2 = CreateProfile(
    LocalPlane=xy_2,
    NumberOfInputs=0,
    catalogueIndex=3,
    inclSS=False,
    lengthUnit="Meter",
    mode="Catalogue",
    Profile_type="Catalogue",
    Catalogue="Europrofile",
    Type="EP HE beams",
    Profile="HE HE140.M",
    typeIndex=27)
profileedit = EditProfile(Profile=profile_2, Measure="Degree")
material_3 = StandardMaterial(Material_Type="Steel", Code_Group="EN1993", Grade="S355")
section = CreateSection(Profile=profileedit, Material=material_3)

# ----
number_slider = Slider(35, range=0..100)

# ---- group: Links
rebar_2 = CreateRebar(Material=material, Diameter_mm=Slider(10, range=0..100), mode="Single", Rebar_Type="Single", Measure="Millimeter")
reinforcement_group = CreateReinforcementGroup(Rebar=rebar_2, Cover_mm=number_slider, Group_Type="Link", Measure="Millimeter")

# ----
reinforcement_group_2 = CreateReinforcementGroup(SpacedRebars=spacing, Cover_mm=number_slider, Group_Type="Perimeter", Measure="Millimeter")
rbg = RebarGroup(flatten([reinforcement_group_2, reinforcement_group]))

# ---- group: Create Section
section_2 = Section(Profile=profile, Material=material_2, RebarGroup=rbg, SubComponent=section)

# ----
section_3 = Section(Section=section_2)  # -> Section, Profile, Material, DesignCode, RebarGroup, SubComponent, SectionCurves
profileedit_2 = EditProfile(Profile=section_3.Profile, Measure="Radian")

# ---- group: Bake these guys
crv = Curve(section_3.SectionCurves)

# ---- group: Analyse solution
analyse = AnalyseSection(Section=section_2)  # -> Results, FailureSurface

# ----
lng = ListLength(List=crv)
neg = Negative(Value=Slider(200, range=0..10000))

# ---- group: Top right corner point
vertex_point = CreateVertexPoint(Y_mm=Slider(150, range=0..1000), Z_mm=Slider(-300, range=-500..0), Measure="Millimeter")

# ---- group: CadTest
int = Integer(lng)

# ----
load = CreateLoad(
    Myy_kN_m=Slider(64, range=0..100),
    Mzz_kN_m=Slider(10, range=0..100),
    Force_Unit="Kilonewton",
    Moment_Unit="KilonewtonMeter")
load_2 = CreateLoad(
    Fx_kN=neg,
    Myy_kN_m=Slider(55, range=0..100),
    Mzz_kN_m=Slider(11, range=0..100),
    Force_Unit="Kilonewton",
    Moment_Unit="KilonewtonMeter")
sls = ServiceabilityResult(Results=analyse.Results, Load=load)  # -> Load, Cracks, MaximumCrack, CrackUtil, Deformation, SecantStiffness, UncrackedMomentRanges
uls = StrengthResult(Results=analyse.Results, Load=load_2)  # -> Load, LoadUtil, Deformation, DeformationUtil, MomentRanges, NeutralAxis

# ---- group: Rebar stress for all bars
rss = RebarStressStrain(Results=analyse.Results, Load=load_2)  # -> Position_mm, ULSStrain, ULSStress, SLSStrain, SLSStress

# ---- group: Concrete stress at YZ point
css = ConcreteStressStrain(Results=analyse.Results, Load=load_2, VertexPoint=vertex_point)  # -> ULSStrain_, ULSStress_MPa, SLSStrain_, SLSStress_MPa

# ----
panel = Panel(rss.Position_mm)
panel_2 = Panel(rss.ULSStrain)
panel_3 = Panel(uls.LoadUtil)
panel_4 = Panel(sls.Cracks)
panel_5 = Panel([css.ULSStrain_, css.ULSStress_MPa, css.SLSStrain_, css.SLSStress_MPa])

# ---- group: Neutral line
line = Line(uls.NeutralAxis)

# ----
panel_6 = Panel(sls.CrackUtil)
pt = ConstructPoint(XCoordinate="500", YCoordinate=0, ZCoordinate=0)
rad = Radians(Degrees=Slider(-170, range=-190..90))

# ---- group: CrackUtilisationTest
num = Number(sls.CrackUtil)

# ---- group: LoadUtilisationTest
num_2 = Number(uls.LoadUtil)

# ---- group: ConcreteStressTest
num_3 = Number([css.ULSStrain_, css.ULSStress_MPa, css.SLSStrain_, css.SLSStress_MPa])

# ----
rectangle = Rectangle(Plane=pt, XSize=Slider(500, range=0..1000), YSize=Slider(605, range=0..1000), Radius=0)  # -> Rectangle, Length
n_m_diagram = NMDiagram(
    Results=analyse.Results,
    MomentAngle_rad=rad,
    Plot=rectangle.Rectangle,
    angle="Radian",
    force="Meganewton",
    Interaction="N-M",
    Measure="Radian")

# ---- group: RebarUlsStrainTest
num_4 = Number(rss.ULSStrain)

# ---- group: RebarUlsStressTest
num_5 = Number(rss.ULSStress)

# ---- group: RebarSlsStrainTest
num_6 = Number(rss.SLSStrain)

# ---- group: RebarSlsStressTest
num_7 = Number(rss.SLSStress)

# ----
crv_2 = Curve(n_m_diagram)
boundary = BoundarySurfaces(Edges=crv_2)
area = Area(Geometry=boundary)  # -> Area, Centroid

# ---- group: NmDiagramTest
num_8 = Number(area.Area)

# ----
panel_7 = Panel(num)
